# Grasshopper definition GH-GCODE-GEN.ghx (Grasshopper 1.0.4)
# Generates a centerline-programmed gcode file from input parameters and single or multiple curves.

# Grasshopper
# GCode
# Generator
# v3
# 
# Brett Ian Balogh
# Spring 2018
# Embodying Code
# ARTTECH 3016
dispatch = Dispatch(DispatchPattern=[True, False])  # -> ListA, ListB
combine = CombineData()  # -> Result, Index
null = NullItem()  # -> NullFlags, InvalidFlags, Description
cull_i = CullIndex(Wrap=True)
panel = Panel("""0
1
2
3""")
header = Panel("G0 G17 G90")
footer = Panel("M30")

feedrate_units_minute = Slider(660, range=0..1000)
retract_height = Slider(2.6, range=0..1000)
cut_depth = Slider(-0.5, range=-1..0)
tolerance_units = Slider(5, range=0..100)
units = ValueList({"INCH": "G20", "MM": "G21"}, selected="MM")
geometry = Curve([<curve referenced from the Rhino model> x2])

c_script = CSharpScript(G=geometry)  # -> out, L, C; inputs G: Curve
# ---------- c_script: C# ----------
    if(G.Degree > 1){
	C = G;
	//L = null;
}
else{
	L = G;
	//C = null;
}
# ---------- end c_script ----------
panel_2 = Panel(c_script.out)
divlength = DivideLength(Curve=c_script.C, Length=tolerance_units)  # -> Points, Tangents, Parameters
end = EndPoints(Curve=c_script.C)  # -> Start, End
lng = ListLength(List=flatten(divlength.Points))
ins = InsertItems(List=divlength.Points, Item=end.End, Indices=lng, Wrap=False)
pline = PolyLine(Vertices=ins, Closed=False)
cp = ControlPoints(Curve=[c_script.L, pline])  # -> Points, Weights, Knots
path_mapper = PathMapper(cp.Points, source="{A;B;C}", target="{B}")
points = PointList(Points=ins, Size=Slider(1, range=0..1))
Z = UnitZ(Factor=cut_depth)
pline_2 = PolyLine(Vertices=path_mapper, Closed=False)  # -> flatten(Polyline)
move = Move(Geometry=pline_2, Motion=Z)  # -> Geometry, Transform
end_2 = EndPoints(Curve=move.Geometry)  # -> flatten(Start), flatten(End)
shift = ShiftList(List=end_2.End, Shift=1, Wrap=True)
pdecon = Deconstruct(Point=shift)  # -> XComponent, YComponent, ZComponent
pdecon_2 = Deconstruct(Point=end_2.Start)  # -> XComponent, YComponent, ZComponent
pt = ConstructPoint(XCoordinate=pdecon_2.XComponent, YCoordinate=pdecon_2.YComponent, ZCoordinate=retract_height)
pt_2 = ConstructPoint(XCoordinate=pdecon.XComponent, YCoordinate=pdecon.YComponent, ZCoordinate=retract_height)
ln = Line(StartPoint=pt, EndPoint=pt_2)
ln_2 = Line(StartPoint=shift, EndPoint=pt_2)
ln_3 = Line(StartPoint=end_2.Start, EndPoint=pt)

col = Colour(RGB(235, 239, 89))
col_2 = Colour(RGB(65, 218, 255))
col_3 = Colour(RGB(244, 17, 0))
col_4 = Colour(RGB(245, 67, 255))
col_5 = Colour(RGB(90, 107, 255))
preview = CustomPreview(Geometry=move.Geometry, Shader=col_2)
preview_2 = CustomPreview(Geometry=ln_3, Shader=col_4)
preview_3 = CustomPreview(Geometry=ln, Shader=col)
preview_4 = CustomPreview(Geometry=ln_2, Shader=col_3)
preview_5 = CustomPreview(Geometry=pline_2, Shader=col_5)

panel_3 = Panel(ln_3)
weave = Weave(Pattern=panel, Stream0=move.Geometry, Stream1=ln_3, Stream2=ln, Stream3=ln_2, NullGaps=False)  # -> flatten(Weave)
join = JoinCurves(Curves=weave, Preserve=False)
cp_2 = ControlPoints(Curve=join)  # -> Points, Weights, Knots
panel_4 = Panel(weave)
pdecon_3 = Deconstruct(Point=cp_2.Points)  # -> XComponent, YComponent, ZComponent
item = ListItem(List=flatten(pdecon_3.XComponent), Index=0, Wrap=True)
item_2 = ListItem(List=flatten(pdecon_3.YComponent), Index=0, Wrap=True)
code = Expression(
    X=pdecon_3.XComponent,
    Y=pdecon_3.YComponent,
    Z=pdecon_3.ZComponent,
    F=feedrate_units_minute,
    Expression="Format(\"G1 X{0:0.000} Y{1:0.000} Z{2:0.000} F{3:0.0}\", X, Y, Z, F)")
code_2 = Expression(X=item, Y=item_2, Z=retract_height, Expression="Format(\"G0 X{0:0.000} Y{1:0.000} Z{2:0.000}\", X, Y, Z)")
move_to_origin_at_retract_height = Panel(code_2)
entwine = Entwine(
    Branch00=header,
    Branch01=units,
    Branch02=move_to_origin_at_retract_height,
    Branch03=code,
    Branch04=footer,
    FlattenInputs=True)

gcode_output = Panel(entwine)
